# Grasshopper definition runner.ghx (Grasshopper 1.0.7)

# ---- group: Module Watcher
modulewatcher = GhPythonScript(enable=Toggle(True))  # -> out; inputs enable: Boolean
# ---------- modulewatcher: Python ----------
from develop import watch_modules


watch_modules(enable)
# ---------- end modulewatcher ----------
panel = Panel(modulewatcher)

# ----
examplecode = GhPythonScript()  # -> out, a
# ---------- examplecode: Python ----------
from logic import say_hi


say_hi()
# ---------- end examplecode ----------

# ---- group: Manual Module Importer
modulereloader = GhPythonScript(run=Button())  # -> out; inputs run: Boolean
# ---------- modulereloader: Python ----------
import os
import sys
import Grasshopper as gh

# Import가 제대로 작동하도록 PATH를 업데이트한다.
root_dir = os.path.dirname(ghdoc.Path)
if root_dir not in sys.path:
    sys.path.append(root_dir)
    # 그래스호퍼 문서 전체의 Recompute를 수행한다.
    gh.Instances.ActiveCanvas.Document.ExpireSolution()

from develop import reload_modules

reload_modules(run)
# ---------- end modulereloader ----------
